# Grasshopper definition 02_EIR_v2.gh (Grasshopper 1.0.7)
# plug-ins: UserDataUtils

X = Slider(6075, range=0..10000)

# ----
# Door placement
Z = Slider(1, range=1..10000)
Y = Slider(8936, range=0..10000)
construct_point = ConstructPoint(XCoordinate=X, YCoordinate=Y, ZCoordinate=Z)

# ----
# Wall placement
Y_2 = Slider(3684, range=0..10000)
Z_2 = Slider(0, range=0..10000)
construct_point_2 = ConstructPoint(XCoordinate=X, YCoordinate=Y_2, ZCoordinate=Z_2)

# ----
# Window placement
Z_3 = Slider(544, range=0..10000)
Y_3 = Slider(4906, range=0..10000)
construct_point_3 = ConstructPoint(XCoordinate=X, YCoordinate=Y_3, ZCoordinate=Z_3)

width_w = Slider(477, range=1..1000)

# ----
# Wall properties
point = Point(construct_point_2)
wall_height_h = Slider(4000, range=1..4000)
length_l = Slider(8585, range=1..100000)
xy_plane = XYPlane(Origin=point)
rectangle = Rectangle(Plane=xy_plane, XSize=width_w, YSize=length_l, Radius=0)  # -> Rectangle, Length

# ----
# Window properties
point_2 = Point(construct_point_3)
length_l_2 = Slider(2578, range=1..10000)
height_h = Slider(1200, range=1..4000)
xy_plane_2 = XYPlane(Origin=point_2)
rectangle_2 = Rectangle(Plane=xy_plane_2, XSize=width_w, YSize=length_l_2, Radius=0)  # -> Rectangle, Length

# ----
# Door properties
height_h_2 = Slider(2347, range=1..4000)
length_l_3 = Slider(1125, range=1..10000)
point_3 = Point(construct_point)
xy_plane_3 = XYPlane(Origin=point_3)
rectangle_3 = Rectangle(Plane=xy_plane_3, XSize=width_w, YSize=length_l_3, Radius=0)  # -> Rectangle, Length

anonymous_stream = DataSender(
    Appointment="Wall",
    Material="Concrete",
    Ambient="Outdoor",
    Max_Cost=Slider(635, range=0..1000),
    Usage="Housing",
    DebouncingDisabled=False,
    manualmode=False,
    remotecontroller=False)  # -> Log, StreamId
panel = Panel(anonymous_stream.StreamId)

rotation = Slider(1.352, range=0..10)

# ----
# Construction of object
unit_z = UnitZ(Factor=height_h)
rotate = Rotate(Geometry=rectangle_2.Rectangle, Angle=rotation, Plane=PlaneXY(0, 0, 0))  # -> Geometry, Transform
extrude = Extrude(Base=rotate.Geometry, Direction=unit_z)
cap_holes = CapHoles(Brep=extrude)
construct_point_4 = ConstructPoint(XCoordinate=0, YCoordinate=0, ZCoordinate=0)
geometry = Geometry(cap_holes)
move = Move(Geometry=geometry, Motion=construct_point_4)  # -> Geometry, Transform

# ----
# Construction of object
unit_z_2 = UnitZ(Factor=height_h_2)
rotate_2 = Rotate(Geometry=rectangle_3.Rectangle, Angle=rotation, Plane=PlaneXY(0, 0, 0))  # -> Geometry, Transform
extrude_2 = Extrude(Base=rotate_2.Geometry, Direction=unit_z_2)
cap_holes_2 = CapHoles(Brep=extrude_2)
construct_point_5 = ConstructPoint(XCoordinate=0, YCoordinate=0, ZCoordinate=0)
geometry_2 = Geometry(cap_holes_2)
move_2 = Move(Geometry=geometry_2, Motion=construct_point_5)  # -> Geometry, Transform

# ----
# Construction of object
unit_z_3 = UnitZ(Factor=wall_height_h)
rotate_3 = Rotate(Geometry=rectangle.Rectangle, Angle=rotation, Plane=PlaneXY(0, 0, 0))  # -> Geometry, Transform
extrude_3 = Extrude(Base=rotate_3.Geometry, Direction=unit_z_3)
cap_holes_3 = CapHoles(Brep=extrude_3)

geometry_3 = Geometry(cap_holes_3)
geometry_4 = Geometry(move.Geometry)
geometry_5 = Geometry(move_2.Geometry)
trim_solid = TrimSolid(Shape=geometry_3, Cutters=[geometry_4, geometry_5])
geometry_6 = Geometry(trim_solid)

anonymous_stream_2 = DataSender(A=geometry_6, B=length_l, C=width_w, D=rotation, DebouncingDisabled=False, manualmode=False, remotecontroller=False)  # -> Log, StreamId
panel_2 = Panel(anonymous_stream_2.StreamId)
