# Grasshopper definition 03_Tender Resp.gh (Grasshopper 1.0.7)
# plug-ins: UserDataUtils, HAL for Grasshopper

anonymous_stream = DataReceiver(ID="szLRvH_eX", deserialize=True)  # -> F6ea1d62A6674e98B0a92821f1e849aa, _2dda2ee0915b479eA4db74ae710b4898, E907d62aF42e47cd9ff7C3e5f7d3f1c5, Bc34c28eBbec42efB7b46b436bf7f69d

# ----
# 3.2) Pre-BIM
panel = Panel("1lGabfJCk")
anonymous_stream_2 = DataReceiver(ID=panel, deserialize=True)  # -> E3b6202f44284da099588e205c20c748, C69843de010148c0AabcBab4cb2dd3f2, E8c011de48514c42Ae5e798b98fb8b52, F09f2195A03c483bBda05ba4f6338365, Bfb27d260e924df3Bd91F47a697c68a2, _20c2002838934388B255Df4da0ec16b1
panel_2 = Panel(anonymous_stream_2.C69843de010148c0AabcBab4cb2dd3f2)
panel_3 = Panel(anonymous_stream_2.E8c011de48514c42Ae5e798b98fb8b52)
geometry = Geometry(anonymous_stream.F6ea1d62A6674e98B0a92821f1e849aa)
panel_4 = Panel(anonymous_stream_2.F09f2195A03c483bBda05ba4f6338365)

panel_5 = Panel("""Outdoor
0""")
sessionsettings = SessionSettings()
panel_6 = Panel("""Indoor
350""")
cherry_picker = CherryPicker(panel_5, ListIndex=0)
cherry_picker_2 = CherryPicker(panel_6, ListIndex=0)
concatenate = Concatenate(FragmentA="Floor", FragmentB=cherry_picker)
concatenate_2 = Concatenate(FragmentA="Floor", FragmentB=cherry_picker_2)

# ----
# 3.3) Assess Task Team capability & capacity
# LAedP Database of possible deliverables
panel_7 = Panel("Wall")

cherry_picker_3 = CherryPicker(panel_6, ListIndex=1)

# ----
# Housing Indoor
panel_8 = Panel("""Concrete
Brick
Steel
Timber""")
panel_9 = Panel("""220
100
350
110""")
text = Text(graft(panel_9))
cherry_picker_4 = CherryPicker("Indoor", ListIndex=0)
graft_tree = GraftTree(Tree=panel_8, IncludeEmptyLists=True, IncludeNullItems=True)
concatenate_3 = Concatenate(A="Housing", Fragment_A=panel_7, Fragment_B=cherry_picker_4)
concatenate_4 = Concatenate(FragmentA=concatenate_3, FragmentB=graft_tree)
weave = Weave(Pattern=[0, 1], Stream0=concatenate_4, Stream1=text, NullGaps=False)

# ----
# Housing Outdoor
panel_10 = Panel(anonymous_stream_2._20c2002838934388B255Df4da0ec16b1)
panel_11 = Panel("""Concrete
Brick
Steel
Timber""")
panel_12 = Panel("""270
150
400
160""")
text_2 = Text(graft(panel_12))
cherry_picker_5 = CherryPicker("Outdoor", ListIndex=0)
graft_tree_2 = GraftTree(Tree=panel_11, IncludeEmptyLists=True, IncludeNullItems=True)
concatenate_5 = Concatenate(A=panel_10, Fragment_A=panel_7, Fragment_B=cherry_picker_5)
concatenate_6 = Concatenate(FragmentA=concatenate_5, FragmentB=graft_tree_2)
weave_2 = Weave(Pattern=[0, 1], Stream0=concatenate_6, Stream1=text_2, NullGaps=False)

number_slider = Slider(0, range=0..10)

# ----
# Curve analysis
deconstruct_brep = DeconstructBrep(Brep=geometry)  # -> Faces, Edges, Vertices
text_3 = Text(deconstruct_brep.Edges)
ghpython_script = GhPythonScript(x=text_3)  # -> out, a
# ---------- ghpython_script: Python ----------
__author__ = "chris"
__version__ = "2020.11.28"

import rhinoscriptsyntax as rs

if x == "Line-like Curve":
    a is None
else:
    a = 1;
# ---------- end ghpython_script ----------
clean_tree = CleanTree(RemoveNulls=True, RemoveInvalid=True, RemoveEmpty=False, Tree=ghpython_script.a)  # -> flatten(Tree)

# ----
# Cost analysis
number_slider_2 = Slider(2, range=0..10)
series = Series(Start=0, Step=number_slider_2, Count=number_slider_2)
entwine = Entwine(
    Branch00=series,
    Branch01=series,
    Branch02=series,
    Branch03=series,
    Branch04=series,
    Branch05=series,
    Branch06=series,
    Branch07=series,
    FlattenInputs=True)
merge = Merge(Data1=weave, Data2=weave_2)
unflatten_tree = UnflattenTree(Tree=merge, Guide=entwine)

# ----
# Compliance check LAed and AingP;
# Capability & capacities
concatenate_7 = Concatenate(B=panel_10, Fragment_A=panel_2, Fragment_B=panel_4, A=panel_3)
match_text = MatchText(Text=merge, RegEx=concatenate_7, Case=True)
text_4 = Text(match_text)
ghpython_script_2 = GhPythonScript(x=text_4)  # -> out, a
# ---------- ghpython_script_2: Python ----------
__author__ = "chris"
__version__ = "2020.11.06"

import rhinoscriptsyntax as rs

if x == "False":
    a = None
else:
    a=1;
# ---------- end ghpython_script_2 ----------
clean_tree_2 = CleanTree(RemoveNulls=True, RemoveInvalid=True, RemoveEmpty=False, Tree=ghpython_script_2.a)
flatten_tree = FlattenTree(Tree=clean_tree_2, Path="{0}")
list_item = ListItem(List=flatten_tree, Index=0, Wrap=True)
number = Number(list_item)

list_item_2 = ListItem(List=unflatten_tree, Index=ghpython_script_2.a, Wrap=True)
clean_tree_3 = CleanTree(RemoveNulls=True, RemoveInvalid=True, RemoveEmpty=False, Tree=list_item_2)  # -> flatten(Tree)
number_2 = Number(anonymous_stream_2.Bfb27d260e924df3Bd91F47a697c68a2)
number_3 = Number(clean_tree_3)

# ----
# 3.4) Establish Task Team capability & capacity
properties = GhPythonScript(x=number, Ambient=panel_4, Appointment=panel_2, Material=panel_3)  # -> out, a, b
# ---------- properties: Python ----------
__author__ = "chris"
__version__ = "2020.11.05"

import rhinoscriptsyntax as rs

if x == 1:
     print "Ok! " +  str(Ambient) + " " + str(Appointment) + " of " + str(Material)
     a = 0
else:
    print "Not ok! " +  str(Ambient) + " " + str(Appointment) + " of " + str(Material) + " not found"
    a = 1
# ---------- end properties ----------
cost = GhPythonScript(x=number_3, y=number_2)  # -> out, a, b
# ---------- cost: Python ----------
__author__ = "chris"
__version__ = "2020.11.28"

import rhinoscriptsyntax as rs

if x is None:
    a = "Not ok; Properties not in compliance"
    b= 1
elif x >= y:
    a = "Not ok; Tender not approved"
    b= 1
else:
    a = "Ok; Tender approved"
    b = 0;
# ---------- end cost ----------
geometry_analysis = GhPythonScript(x=clean_tree)  # -> a, b
# ---------- geometry_analysis: Python ----------
__author__ = "chris"
__version__ = "2020.11.28"

import rhinoscriptsyntax as rs

if x is None:
    a = "Ok; Supported shapes"
    b = 0
else:
    a = "Not Ok; Not supported shapes"
    b = 1;
# ---------- end geometry_analysis ----------
panel_13 = Panel(geometry_analysis.a)
panel_14 = Panel(properties.out)
panel_15 = Panel(cost.a)
addition = Addition(A=geometry_analysis.b, B=properties.a, C=cost.b)
ghpython_script_3 = GhPythonScript(x=addition)  # -> out, a
# ---------- ghpython_script_3: Python ----------
__author__ = "chris"
__version__ = "2020.12.20"

import rhinoscriptsyntax as rs
if x == 0:
    a = 0
else:
    a = x;
# ---------- end ghpython_script_3 ----------
anonymous_stream_3 = DataSender(SendData=ghpython_script_3.a, DebouncingDisabled=False, manualmode=False, remotecontroller=False)  # -> Log, StreamId

panel_16 = Panel(number_2)
