# Grasshopper definition 04_Pick and Move_v5.gh (Grasshopper 1.0.7)
# plug-ins: UserDataUtils, HAL for Grasshopper, RobotComponents.Gh

sessionsettings = SessionSettings()

# ----
# Brick Dimensions
number_slider = Slider(54, range=0..500)
number = Number(Slider(108, range=0..500))
number_2 = Number(number_slider)
number_3 = Number(Slider(228, range=0..500))

# ----
# Max. row = 7
number_slider_2 = Slider(7, range=1..100)
number_4 = Number(number_slider_2)

# ----
# Max. colum = 20
number_slider_3 = Slider(20, range=1..100)
multiplication = Multiplication(A=number_slider_3, B=Slider(0.5, range=0..1))
round = Round(Number=multiplication)  # -> Nearest, Floor, Ceiling

# ----
# Create target planes
number_slider_4 = Slider(682, range=0..1000)
unit_z = UnitZ(Factor=number_slider_4)

# ----
# Code Generation: Target Definitions
# Defines target, name needs to be unique
robot_joint_position = RobotJointPosition(RobotAxisValue1=0, RobotAxisValue2=0, RobotAxisValue3=0, RobotAxisValue4=0, RobotAxisValue5=0, RobotAxisValue6=0)
joint_target = JointTarget(Name="Start", RobotJointPosition=robot_joint_position)

# ----
# Code Generation: Custom speeddata
number_slider_5 = Slider(250, range=0..250)
speed_data = ActionSpeedData(Name="custom_speeddata", TCPVelocity=number_slider_5, ORIVelocity=500, LEAXVelocity=5000, REAXVelocity=1000)

# ----
# Robot; Tool & Robot properties, Definition of robot target, action and bundling info
# Definitions: Robot Tool
mesh = Mesh(flatten(Tree({0}: [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], {0;0;0}: [], {0;0;0;0}: [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], {0;0;0;1}: [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], {0;0;0;1;0}: [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], {0;0;0;2}: [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]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)))
mesh_2 = Mesh(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)
rotate = Rotate(Geometry=mesh, Angle=1.570796327, Plane=PlaneXY(0, 0, 0))  # -> Geometry, Transform
scale = Scale(Geometry=mesh, Center=Point(0, 0, 0), Factor=Slider(3.038, range=0..10))  # -> Geometry, Transform
point = Point(Point(4.813098392, 0, 553.0518988))
point_2 = Point(Point(-0.6056381694, 0, 224.7258779))
xy_plane = XYPlane(Origin=point_2)
xy_plane_2 = XYPlane(Origin=point)
robot_tool_from_planes = RobotToolFromPlanes(Name="gripper", Mesh=scale.Geometry, AttachmentPlane=xy_plane, ToolPlane=xy_plane_2)

# ----
# Code Generation: Robot actions
value_list = ValueList({"MoveAbsJ": 0, "MoveL": 1, "MoveJ": 2}, selected="MoveAbsJ")
value_list_2 = ValueList({"Instruction": 0, "Declaration": 1}, selected="Instruction")
move = Move(
    Target=joint_target,
    SpeedData=speed_data,
    MovementType=value_list,
    Override_Robot_Tool=False,
    Override_Work_Object=False,
    Set_Digital_Output=False)
aac = ActionAutoAxisConfigurator(IsActive=Toggle(True))
T = ActionTimer(Duration="0.5")
T_2 = ActionTimer(Duration="0.5")
T_3 = ActionTimer(Duration="0.5")
T_4 = ActionTimer(Duration="0.5")
T_5 = ActionTimer(Duration="0.5")
do = ActionDigitalOutput(Name="DO_1", State=Toggle(True))
cl = CodeLine(Code="! new block placement", Type=value_list_2)

do_2 = ActionDigitalOutput(Name="DO_1", State=Toggle(False))

# ----
# Definitions: Robot
number_slider_6 = Slider(1, range=0..90)
quaternion_to_plane = QuaternionToPlane(
    CoordX=Slider(1498, range=0..10000),
    CoordY=Slider(-250, range=-10000..10000),
    CoordZ=Slider(0, range=0..10000),
    QuaternionA=Slider(1, range=-2..100),
    QuaternionB=Slider(0, range=0..10),
    QuaternionC=Slider(0, range=0..10),
    QuaternionD=number_slider_6)
abb_irb6700_300_2_7 = ABBIRB670030027(PositionPlane=quaternion_to_plane, RobotTool=robot_tool_from_planes)

# ----
# Receive, Move & Rotate Geometry
panel = Panel("szLRvH_eX")

anonymous_stream = DataReceiver(ID=panel, deserialize=True)  # -> F6ea1d62A6674e98B0a92821f1e849aa, _2dda2ee0915b479eA4db74ae710b4898, E907d62aF42e47cd9ff7C3e5f7d3f1c5, Bc34c28eBbec42efB7b46b436bf7f69d
anonymous_stream_2 = DataReceiver(ID="lXcX0Jfiv", deserialize=True)

geometry = Geometry(anonymous_stream.F6ea1d62A6674e98B0a92821f1e849aa)
number_5 = Number(anonymous_stream_2)
number_6 = Number(anonymous_stream.Bc34c28eBbec42efB7b46b436bf7f69d)
ghpython_script = GhPythonScript(x=number_5, y=geometry)  # -> out, a
# ---------- ghpython_script: Python ----------
__author__ = "chris"
__version__ = "2020.12.20"

import rhinoscriptsyntax as rs
if x == 0:
    a = y
else:
    a is None;
# ---------- end ghpython_script ----------
geometry_2 = Geometry(ghpython_script.a)

# ----
# Move wall to origin
deconstruct_brep = DeconstructBrep(Brep=geometry_2)  # -> Faces, Edges, Vertices
construct_point = ConstructPoint(XCoordinate=0, YCoordinate=0, ZCoordinate=0)
closest_points = ClosestPoints(Point=construct_point, Cloud=deconstruct_brep.Vertices, Count=3)  # -> simplify(ClosestPoint), CPIndex, Distance
cherry_picker = CherryPicker(closest_points.ClosestPoint, ListIndex=0)
construct_point_2 = ConstructPoint(XCoordinate=0, YCoordinate=0, ZCoordinate=0)
line = Line(StartPoint=cherry_picker, EndPoint=construct_point_2)
move_2 = Move(Geometry=geometry_2, Motion=line)  # -> Geometry, Transform

# ----
# Simulation of Robot placing
geometry_3 = Geometry(geometry)
deconstruct_brep_2 = DeconstructBrep(Brep=geometry_3)  # -> Faces, Edges, Vertices
cherry_picker_2 = CherryPicker(deconstruct_brep_2.Edges, ListIndex=8)
cherry_picker_3 = CherryPicker(deconstruct_brep_2.Edges, ListIndex=4)
multiplication_2 = Multiplication(A=Slider(20, range=0..60), B=Slider(54, range=0..60))
length = Length(Curve=cherry_picker_2)
length_2 = Length(Curve=cherry_picker_3)
multiplication_3 = Multiplication(A=Slider(7, range=0..250), B=Slider(228, range=0..250))
division = Division(A=length, B=multiplication_2)
number_slider_7 = Slider(250, range=0..250)
round_2 = Round(Number=division)  # -> Nearest, Floor, Ceiling
division_2 = Division(A=length_2, B=multiplication_3)
round_3 = Round(Number=division_2)  # -> Nearest, Floor, Ceiling
subtraction = Subtraction(A=multiplication_3, B=number_slider_7)
series = Series(Start=0, Step=multiplication_2, Count=round_2.Ceiling)
series_2 = Series(Start=subtraction, Step=multiplication_3, Count=round_3.Ceiling)  # -> graft(Series)
subtraction_2 = Subtraction(A=series_2, B=subtraction)
unit_y = UnitY(Factor=subtraction_2)
negative = Negative(Value=number_slider_7)
construct_point_3 = ConstructPoint(XCoordinate=Slider(1498, range=0..10000), YCoordinate=negative, ZCoordinate=series)
move_3 = Move(Geometry=construct_point_3, Motion=unit_y)  # -> Geometry, Transform
flip_matrix = FlipMatrix(Data=move_3.Geometry)  # -> flatten(Data)
point_3 = Point(flip_matrix)

# ----
# Rotation final figure
negative_2 = Negative(Value=number_6)
xy_plane_3 = XYPlane(Origin=Point(0, 0, 0))
rotate_2 = Rotate(Geometry=move_2.Geometry, Angle=negative_2, Plane=xy_plane_3)  # -> Geometry, Transform

geometry_4 = Geometry(rotate_2.Geometry)

# ----
# Placing Bricks; Geometries, Placing Positions,  Fix order, Trim openings
geometry_5 = Geometry(geometry_4)
area = Area(Geometry=geometry_5)  # -> Area, Centroid
number_7 = Number(number_4)
geometry_6 = Geometry(geometry_5)
number_8 = Number(number_7)

# ----
# Creation and placing of Drop Blocks
x = Number(number)
y = Number(number_3)
z = Number(number_2)
point_4 = Point(area.Centroid)
deconstruct = Deconstruct(Point=point_4)  # -> XComponent, YComponent, ZComponent
multiplication_4 = Multiplication(A=z, B=Slider(2, range=0..10))
construct_point_4 = ConstructPoint(XCoordinate=deconstruct.XComponent, YCoordinate=0, ZCoordinate=0)
series_3 = Series(Start=0, Step=graft(multiplication_4), Count=multiplication)
point_5 = Point(construct_point_4)
unit_z_2 = UnitZ(Factor=series_3)
domain_box = DomainBox(Base=point_5, X=x, Y=y, Z=z)
series_4 = Series(Start=0, Step=y, Count=number_7)
unit_y_2 = UnitY(Factor=series_4)
move_4 = Move(Geometry=domain_box, Motion=unit_y_2)  # -> Geometry, Transform
move_5 = Move(Geometry=graft(move_4.Geometry), Motion=unit_z_2)  # -> Geometry, Transform

# ----
# Half brick
deconstruct_2 = Deconstruct(Point=point_5)  # -> XComponent, YComponent, ZComponent
z_2 = Number(z)
x_2 = Number(x)
y_2 = Number(y)
construct_point_5 = ConstructPoint(XCoordinate=deconstruct_2.XComponent, YCoordinate=deconstruct_2.YComponent, ZCoordinate=z_2)
division_3 = Division(A=y_2, B=Slider(2, range=0..10))
domain_box_2 = DomainBox(Base=construct_point_5, X=x_2, Y=division_3, Z=z_2)
multiplication_5 = Multiplication(A=z_2, B=Slider(2, range=0..10))
series_5 = Series(Start=0, Step=multiplication_5, Count=round.Floor)
unit_z_3 = UnitZ(Factor=series_5)  # -> graft(UnitVector)
move_6 = Move(Geometry=graft(domain_box_2), Motion=unit_z_3)  # -> Geometry, Transform

# ----
# Lvl 2 bricks
deconstruct_box = DeconstructBox(Box=domain_box_2)  # -> Plane, X, Y, Z
y_3 = Number(y_2)
z_3 = Number(z_2)
x_3 = Number(x)
number_9 = Number(deconstruct_box.Y)
number_10 = Number(deconstruct_2.YComponent)
addition = Addition(A=number_9, B=number_10)
construct_point_6 = ConstructPoint(XCoordinate=deconstruct_2.XComponent, YCoordinate=addition, ZCoordinate=z_3)
domain_box_3 = DomainBox(Base=construct_point_6, X=x_3, Y=y_3, Z=z_3)
multiplication_6 = Multiplication(A=z_3, B=Slider(2, range=0..10))
series_6 = Series(Start=0, Step=multiplication_6, Count=round.Floor)
unit_z_4 = UnitZ(Factor=series_6)
subtraction_3 = Subtraction(A=number_8, B=Slider(1, range=0..1))
series_7 = Series(Start=0, Step=y_3, Count=subtraction_3)
move_7 = Move(Geometry=domain_box_3, Motion=unit_z_4)  # -> Geometry, Transform
unit_y_3 = UnitY(Factor=series_7)
move_8 = Move(Geometry=graft(move_7.Geometry), Motion=unit_y_3)  # -> Geometry, Transform

# ----
# Fix order place
flip_matrix_2 = FlipMatrix(Data=move_5.Geometry)
brep = Brep(move_8.Geometry)
brep_2 = Brep(move_6.Geometry)
brep_join = BrepJoin(Breps=reverse([brep_2, brep]))  # -> Breps, Closed
geometry_7 = Geometry(simplify(flatten([flip_matrix_2, brep_join.Breps])))
cherry_picker_4 = CherryPicker(geometry_7, ListIndex=36)

# ----
# Defining openings (max 3)
brep_edges = BrepEdges(Brep=flatten(geometry_6))  # -> Naked, Interior, NonManifold
number_slider_8 = Slider(8, range=0..10)
list_length = ListLength(List=brep_edges.Naked)
division_4 = Division(A=list_length, B=number_slider_8)
series_8 = Series(Start=number_slider_8, Step=number_slider_8, Count=division_4)
partition_list = PartitionList(List=brep_edges.Naked, Size=series_8)  # -> simplify(Chunks)
explode_tree = ExplodeTree(Data=partition_list)  # -> Branch0, Branch1, Branch2, Branch3, Branch4, Branch5
curve = Curve(explode_tree.Branch1)
curve_2 = Curve(explode_tree.Branch2)
curve_3 = Curve(explode_tree.Branch0)

# ----
# Creation Box Window 2 Place
construct_point_7 = ConstructPoint(XCoordinate=0, YCoordinate=0, ZCoordinate=0)
explode = Explode(Curve=curve_2, Recursive=True)  # -> Segments, flatten(Vertices)
closest_points_2 = ClosestPoints(Point=construct_point_7, Cloud=explode.Vertices, Count=Slider(10000, range=0..10000))  # -> reverse(ClosestPoint), CPIndex, Distance
cherry_picker_5 = CherryPicker(closest_points_2.ClosestPoint, ListIndex=0)
closest_point = ClosestPoint(Point=construct_point_7, Cloud=explode.Vertices)  # -> ClosestPoint, CPIndex, Distance
point_6 = Point(cherry_picker_5)
box_2pt = Box2Pt(PointA=closest_point.ClosestPoint, PointB=point_6, Plane=PlaneXY(0, 0, 0))

# ----
# Creation Box Door Place
construct_point_8 = ConstructPoint(XCoordinate=0, YCoordinate=0, ZCoordinate=0)
explode_2 = Explode(Curve=curve, Recursive=True)  # -> Segments, flatten(Vertices)
closest_points_3 = ClosestPoints(Point=construct_point_8, Cloud=explode_2.Vertices, Count=Slider(10000, range=0..10000))  # -> reverse(ClosestPoint), CPIndex, Distance
closest_point_2 = ClosestPoint(Point=construct_point_8, Cloud=explode_2.Vertices)  # -> ClosestPoint, CPIndex, Distance
cherry_picker_6 = CherryPicker(closest_points_3.ClosestPoint, ListIndex=0)
point_7 = Point(cherry_picker_6)
box_2pt_2 = Box2Pt(PointA=closest_point_2.ClosestPoint, PointB=point_7, Plane=PlaneXY(0, 0, 0))

# ----
# Creation Box Window Place
explode_3 = Explode(Curve=curve_3, Recursive=True)  # -> Segments, flatten(Vertices)
construct_point_9 = ConstructPoint(XCoordinate=0, YCoordinate=0, ZCoordinate=0)
closest_points_4 = ClosestPoints(Point=construct_point_9, Cloud=explode_3.Vertices, Count=Slider(10000, range=0..10000))  # -> reverse(ClosestPoint), CPIndex, Distance
cherry_picker_7 = CherryPicker(closest_points_4.ClosestPoint, ListIndex=0)
closest_point_3 = ClosestPoint(Point=construct_point_9, Cloud=explode_3.Vertices)  # -> ClosestPoint, CPIndex, Distance
point_8 = Point(cherry_picker_7)
box_2pt_3 = Box2Pt(PointA=closest_point_3.ClosestPoint, PointB=point_8, Plane=PlaneXY(0, 0, 0))

# ----
# Trim door place
volume = Volume(Geometry=graft(geometry_7))  # -> Volume, Centroid
point_in_brep = PointInBrep(Brep=box_2pt_2, Point=volume.Centroid, Strict=True)  # -> graft(Inside)
cull_pattern = CullPattern(List=graft(geometry_7), CullPattern=invert(point_in_brep))  # -> flatten(List)
volume_2 = Volume(Geometry=graft(cull_pattern))  # -> Volume, Centroid
point_in_brep_2 = PointInBrep(Brep=box_2pt_3, Point=volume_2.Centroid, Strict=True)  # -> graft(Inside)

# ----
# Trim window place
cull_pattern_2 = CullPattern(List=graft(cull_pattern), CullPattern=invert(point_in_brep_2))  # -> flatten(List)
trim_solid = TrimSolid(Shape=cull_pattern_2, Cutters=[box_2pt_2, box_2pt_3])
cap_holes_ex = CapHolesEx(Brep=trim_solid)  # -> Brep, Caps, Solid

geometry_8 = Geometry(cap_holes_ex.Brep)
volume_3 = Volume(Geometry=geometry_8)  # -> Volume, Centroid
xy_plane_4 = XYPlane(Origin=volume_3.Centroid)
flip_plane_x = FlipPlaneX(Plane=xy_plane_4)
list_item = ListItem(List=reverse(flip_plane_x), Index="0", Wrap=True)
move_9 = Move(Geometry=list_item, Motion=unit_z)  # -> Geometry, Transform

robot_target = RobotTarget(
    Name="DropDownTarget",
    Plane=flip_plane_x,
    AxisConfiguration=Slider(0, range=0..7),
    Set_External_Joint_Position=False,
    Set_Reference_Plane=False)  # -> graft(RobotTarget)
robot_target_2 = RobotTarget(
    Name="DropDownBasePlane",
    Plane=move_9.Geometry,
    AxisConfiguration=Slider(0, range=0..7),
    Set_External_Joint_Position=False,
    Set_Reference_Plane=False)

value_list_3 = ValueList({"MoveAbsJ": 0, "MoveL": 1, "MoveJ": 2}, selected="MoveL")
value_list_4 = ValueList({"MoveAbsJ": 0, "MoveL": 1, "MoveJ": 2}, selected="MoveJ")
move_10 = Move(
    Target=robot_target,
    SpeedData=Slider(100, range=0..250),
    MovementType=value_list_3,
    Override_Robot_Tool=False,
    Override_Work_Object=False,
    Set_Digital_Output=False)
move_11 = Move(
    Target=robot_target_2,
    SpeedData=speed_data,
    MovementType=value_list_4,
    Override_Robot_Tool=False,
    Override_Work_Object=False,
    Set_Digital_Output=False)

# ----
# Downward movement to drop position
value_list_5 = ValueList({"MoveAbsJ": 0, "MoveL": 1, "MoveJ": 2}, selected="MoveAbsJ")
move_12 = Move(
    Target=robot_target_2,
    SpeedData=speed_data,
    MovementType=value_list_5,
    Override_Robot_Tool=False,
    Override_Work_Object=False,
    Set_Digital_Output=False)

# ----
# Creation and placing of Pick Blocks
number_slider_9 = Slider(200, range=-200..200)
construct_point_10 = ConstructPoint(XCoordinate=Slider(2465, range=0..10000), YCoordinate=number_slider_9, ZCoordinate=0)
y_4 = Number(number_3)
z_4 = Number(number_2)
x_4 = Number(number)
point_9 = Point(construct_point_10)
domain_box_4 = DomainBox(Base=point_9, X=x_4, Y=y_4, Z=z_4)
multiplication_7 = Multiplication(A=z_4, B=Slider(2, range=0..10))

# ----
# Picking Bricks; Geometries, Picking Positions,  Fix order
list_length_2 = ListLength(List=flatten(trim_solid))
division_5 = Division(A=list_length_2, B=number_4)
number_11 = Number(number_4)
round_4 = Round(Number=division_5)  # -> Nearest, Floor, Ceiling
multiplication_8 = Multiplication(A=round_4.Ceiling, B=Slider(0.5, range=0..1))
round_5 = Round(Number=multiplication_8)  # -> Nearest, Floor, Ceiling
number_12 = Number(round_5.Floor)
number_slider_10 = Slider(0, range=0..1)
number_13 = Number(number_4)
series_9 = Series(Start=0, Step=number_slider_10, Count=number_13)
series_10 = Series(Start=Slider(1, range=0..1), Step=number_slider_10, Count=number_13)
panel_2 = Panel([series_10, series_9])
reverse_list = ReverseList(List=panel_2)

# ----
# Half brick Pick Up
deconstruct_3 = Deconstruct(Point=point_9)  # -> XComponent, YComponent, ZComponent
x_5 = Number(x_4)
y_5 = Number(y_4)
z_5 = Number(z_4)
construct_point_11 = ConstructPoint(XCoordinate=deconstruct_3.XComponent, YCoordinate=deconstruct_3.YComponent, ZCoordinate=z_5)
division_6 = Division(A=y_5, B=Slider(2, range=0..10))
domain_box_5 = DomainBox(Base=construct_point_11, X=x_5, Y=division_6, Z=z_5)
multiplication_9 = Multiplication(A=z_5, B=Slider(2, range=0..10))
series_11 = Series(Start=0, Step=multiplication_9, Count=number_12)
unit_z_5 = UnitZ(Factor=series_11)  # -> graft(UnitVector)
move_13 = Move(Geometry=graft(domain_box_5), Motion=unit_z_5)  # -> reverse(Geometry), Transform

series_12 = Series(Start=0, Step=y_4, Count=number_11)
unit_y_4 = UnitY(Factor=series_12)
move_14 = Move(Geometry=domain_box_4, Motion=unit_y_4)  # -> Geometry, Transform
series_13 = Series(Start=0, Step=multiplication_7, Count=round_5.Nearest)
unit_z_6 = UnitZ(Factor=series_13)  # -> flatten(UnitVector)
move_15 = Move(Geometry=graft(move_14.Geometry), Motion=unit_z_6)  # -> Geometry, Transform

# ----
# Lvl 2 bricks
deconstruct_box_2 = DeconstructBox(Box=domain_box_5)  # -> Plane, X, Y, Z
x_6 = Number(x_5)
y_6 = Number(y_5)
z_6 = Number(z_5)
number_14 = Number(deconstruct_box_2.Y)
number_15 = Number(deconstruct_3.YComponent)
addition_2 = Addition(A=number_14, B=number_15)
construct_point_12 = ConstructPoint(XCoordinate=deconstruct_3.XComponent, YCoordinate=addition_2, ZCoordinate=z_6)
domain_box_6 = DomainBox(Base=construct_point_12, X=x_6, Y=y_6, Z=z_6)
multiplication_10 = Multiplication(A=z_6, B=Slider(2, range=0..10))
series_14 = Series(Start=0, Step=multiplication_10, Count=number_12)
number_16 = Number(number_11)
unit_z_7 = UnitZ(Factor=series_14)
subtraction_4 = Subtraction(A=number_16, B=Slider(1, range=0..1))
series_15 = Series(Start=0, Step=y_6, Count=subtraction_4)
move_16 = Move(Geometry=domain_box_6, Motion=unit_z_7)  # -> Geometry, Transform
unit_y_5 = UnitY(Factor=series_15)
move_17 = Move(Geometry=graft(move_16.Geometry), Motion=unit_y_5)  # -> reverse(Geometry), Transform

flip_matrix_3 = FlipMatrix(Data=move_15.Geometry)

# ----
# Fix Pick Order
geometry_9 = Geometry(flatten([move_17.Geometry, move_13.Geometry]))
geometry_10 = Geometry([move_17.Geometry, move_13.Geometry])
tree_statistics = TreeStatistics(Tree=flip_matrix_3)  # -> Paths, Length, Count
geometry_11 = Geometry(flatten(flip_matrix_3))
tree_statistics_2 = TreeStatistics(Tree=geometry_10)  # -> Paths, Length, Count
addition_3 = Addition(A=tree_statistics_2.Count, B=tree_statistics.Count)  # -> flatten(Result)
path_mapper = PathMapper(geometry_11, source="{A}(i)", target="{A}(item_count - 1 - i)")
path_mapper_2 = PathMapper(geometry_9, source="{A}(i)", target="{A}(item_count - 1 - i)")
ghpython_script_2 = GhPythonScript(x=addition_3, y=path_mapper_2, z=path_mapper)  # -> out, a, b, c
# ---------- ghpython_script_2: Python ----------
__author__ = "chris"
__version__ = "2020.11.18"

import rhinoscriptsyntax as rs

if x%2:
    a = "test"
    b = z
    c = y

else:
    a = x 
    b = y
    c = z;
# ---------- end ghpython_script_2 ----------
weave = Weave(Pattern=panel_2, Stream0=ghpython_script_2.c, Stream1=ghpython_script_2.b, NullGaps=False)  # -> flatten(Weave)
cherry_picker_8 = CherryPicker(weave, ListIndex=0)

geometry_12 = Geometry(weave)
volume_4 = Volume(Geometry=geometry_12)  # -> Volume, Centroid
xy_plane_5 = XYPlane(Origin=volume_4.Centroid)
flip_plane_x_2 = FlipPlaneX(Plane=xy_plane_5)
list_item_2 = ListItem(List=flip_plane_x_2, Index="0", Wrap=True)
move_18 = Move(Geometry=list_item_2, Motion=unit_z)  # -> Geometry, Transform

robot_target_3 = RobotTarget(
    Name="PickUpTarget",
    Plane=flip_plane_x_2,
    AxisConfiguration=Slider(0, range=0..7),
    Set_External_Joint_Position=False,
    Set_Reference_Plane=False)  # -> graft(RobotTarget)
robot_target_4 = RobotTarget(
    Name="PickUpBasePlane",
    Plane=move_18.Geometry,
    AxisConfiguration=Slider(0, range=0..7),
    Set_External_Joint_Position=False,
    Set_Reference_Plane=False)

# ----
# In this example DO_1 would open and close the
# defined robot tool (gripper) depending on its state
number_slider_11 = Slider(100, range=0..250)
value_list_6 = ValueList({"MoveAbsJ": 0, "MoveL": 1, "MoveJ": 2}, selected="MoveJ")
value_list_7 = ValueList({"MoveAbsJ": 0, "MoveL": 1, "MoveJ": 2}, selected="MoveJ")
value_list_8 = ValueList({"fine": -1, "z0": 0, "z1": 1, "z5": 5, "z10": 10, "z15": 15, "z20": 20, "z30": 30, "z40": 40, "z50": 50, "z60": 60, "z80": 80, "z100": 100, "z150": 150, "z200": 200}, selected="fine")
value_list_9 = ValueList({"fine": -1, "z0": 0, "z1": 1, "z5": 5, "z10": 10, "z15": 15, "z20": 20, "z30": 30, "z40": 40, "z50": 50, "z60": 60, "z80": 80, "z100": 100, "z150": 150, "z200": 200}, selected="fine")
move_19 = Move(
    Target=robot_target_3,
    SpeedData=number_slider_11,
    MovementType=value_list_6,
    ZoneData=value_list_8,
    Override_Robot_Tool=False,
    Override_Work_Object=False,
    Set_Digital_Output=False)
move_20 = Move(
    Target=robot_target_4,
    SpeedData=speed_data,
    MovementType=value_list_7,
    ZoneData=value_list_9,
    Override_Robot_Tool=False,
    Override_Work_Object=False,
    Set_Digital_Output=False)
do_3 = ActionDigitalOutput(Name="DO_1", State=Toggle(True))

# ----
# Downward movement to pick position
value_list_10 = ValueList({"MoveAbsJ": 0, "MoveL": 1, "MoveJ": 2}, selected="MoveL")
move_21 = Move(
    Target=robot_target_4,
    SpeedData=speed_data,
    MovementType=value_list_10,
    Override_Robot_Tool=False,
    Override_Work_Object=False,
    Set_Digital_Output=False)

# ----
# Code Generation: Bundeling
weave_2 = Weave(
    Pattern=[0, 1, 2, 3, 4, 5, 6, 7, 8, 9, 10, 11, 12, 13],
    Stream0=cl,
    Stream1=move_20,
    Stream2=do_3,
    Stream3=move_19,
    Stream4=T_2,
    Stream5=do_2,
    Stream6=T_3,
    Stream7=move_21,
    Stream8=move_11,
    Stream9=move_10,
    Stream10=T_4,
    Stream11=do,
    Stream12=T_5,
    Stream13=move_12,
    NullGaps=False)
merge = Merge(Data1=flatten(aac), Data2=flatten(move), Data3=flatten(weave_2))

# ----
# RAPID code and path robot motion
# Path Generator
number_slider_12 = Slider(87, range=0..200)
# It allows to compute the robot path and simulate its execution. For programs
# with large number of targets, a button can be plugged in the U input, to avoid
# recomputing the toolpath at every stage.
# 
# !!! WARNING !!!
# While RobotComponents toolpath generator is fairly accurate, there is no
# provided guarantee that the simulated toolpath will not differ when executing
# on a real robot. Always use a suitable simulation engine (e.g. RobotStudio)
# before uploading code to a real robot.
path_generator = PathGenerator(
    Robot=abb_irb6700_300_2_7,
    Action=merge,
    Interpolations=number_slider_12,
    AnimationSlider=Slider(0, range=0..1),
    Update=Button(),
    Set_Preview_Curve=True,
    Set_Preview_Mesh=True)  # -> Plane, ExternalAxisPlanes, RobotJointPosition, ExternalJointPosition, ToolPath
code_generation_base_and_main_code_gener = CodeGenerationBaseAndMainCodeGeneration(ri=abb_irb6700_300_2_7, action=merge)  # -> program_module, system_module; "Code Generation: Base and Main Code Generation"
controller_utility_realtime_connection = ControllerUtilityRealtimeConnection(
    robot=abb_irb6700_300_2_7,
    M=code_generation_base_and_main_code_gener.program_module,
    B=code_generation_base_and_main_code_gener.system_module)

curve_4 = Curve(path_generator.ToolPath)
length_3 = Length(Curve=curve_4)
anonymous_stream_3 = DataSender(Path=curve_4, Code=merge, Placing=point_3, DebouncingDisabled=False, manualmode=False, remotecontroller=False)  # -> Log, StreamId
panel_3 = Panel(length_3)

# ==== cluster ControllerUtilityRealtimeConnection

# ----
# Pick controller
button = Button()
get_controller = GetController(Update=button)

M = ClusterInput()
B = ClusterInput()

# ----
# Remote connection: RAPID code upload
boolean_toggle = BooleanToggle(True)
remote_connection = RemoteConnection(
    RobotController=get_controller,
    Connect=boolean_toggle,
    Upload=Button(),
    Run=Button(),
    Stop=Button(),
    MainCode=M,
    BaseCode=B)
panel = Panel(remote_connection)

# ----
# Read the state of a digital input
panel_2 = Panel("DI_1")
get_digital_input = GetDigitalInput(RobotController=get_controller, DIName=panel_2)

# ----
# Read the state of a digital output
panel_3 = Panel("DO_1")
get_digital_output = GetDigitalOutput(RobotController=get_controller, DOName=panel_3)

# ----
# Set the state of a digital input
panel_4 = Panel("DI_1")
set_digital_input = SetDigitalInput(RobotController=get_controller, DIName=panel_4, State=Toggle(False), Update=Button())

# ----
# Set the state of a digital output
panel_5 = Panel("DO_1")
set_digital_output = SetDigitalOutput(RobotController=get_controller, DOName=panel_5, State=Toggle(False), Update=Button())

robot = ClusterInput()

# ----
# Simulation: Realtime robot pose visualization
timer = Timer(TimerInterval=20, Target=get_axis_values)  # disabled
get_axis_values = GetAxisValues(RobotController=get_controller)  # -> RobotJointPosition, ExternalAxisValues
forward_kinematics = ForwardKinematics(Robot=robot, RobotJointPosition=get_axis_values.RobotJointPosition, Set_Hide_Mesh=False)  # -> PosedMeshes, EndPlane, ExternalAxisPlanes

# ----
# Controller Utility: Realtime Connection
panel_6 = Panel(get_digital_output)

boolean = Boolean(get_digital_input)

# ==== cluster CodeGenerationBaseAndMainCodeGeneration
ri = ClusterInput()
action = ClusterInput()

# ----
# Code Generation: Base and Main Code Generation
# Contains Robot Movement Instructions
# If you want to save the
# RAPID code to a file
# you can right-click on
# the component and
# select one of the menu
# items.
# Contains Robot Tool Definitions
rapid_generator = RAPIDGenerator(Robot=ri, Action=action, ProgramName="MainModule", SystemName="BASE", Update=True)  # -> ProgramModule, SystemModule
panel = Panel(rapid_generator.ProgramModule)
panel_2 = Panel(rapid_generator.SystemModule)

program_module = ClusterOutput(rapid_generator.ProgramModule)
system_module = ClusterOutput(rapid_generator.SystemModule)
